# Dynamo graph solar radiation optimizer.dyn (Dynamo 0.6.3.27582)

select_family_instance = FamilyInstanceCreatorSelection()  # 1 picked in the model
string = StringInput("Setback_W")
number = DoubleInput(9)
number_2 = DoubleInput(100)
number_3 = DoubleInput(1)
list = NewList(index0=number_3, index1=number_3)
filename = StringFilename("C:\Users\Mike\Desktop\testsolarNYC.csv")
watch_file = FileWatcher(filename)
solarradopt = Custom[solarradopt](family_instance=select_family_instance, parameter=string, amount_to_increment_by=number, maximum_base_case=number_2, current_parameter_value=number_3, accumulated_parameter_values_and_solar_data=list, path_to_solar_data=filename, file_watcher_object=watch_file)
solarradupdate = Custom[solarradupdate](family_instance=select_family_instance, parameter=string, result=solarradopt.result)
