# Dynamo graph solar radiation optimizer_rotation_simple.dyn (Dynamo 0.6.3.38003)

# note: family instance to change parameters on
select_family_instance = FamilyInstanceCreatorSelection()  # 1 picked in the model
# note: parameter name to change
string = StringInput("increment")
# note: amount to increment parameter at each step
number = DoubleInput(1)
# note: max value for increment parameter
number_2 = DoubleInput(36)
number_3 = DoubleInput(1)
number_4 = DoubleInput(0)
# note: this is the list we're going to store our newly calculated solar data in, each time we'll either hold onto this list or replace the values in it. [solar value, parameter value]
list = NewList(index0=number_4, index1=number_3)
# note: path to exported solar data file
filename = StringFilename("C:\Users\Mike\Desktop\test.csv")
# note: way to see if the solar data has finished calcualting
watch_file = FileWatcher(filename)
# note: This node is our recursive call, this node calls itself multiple times, once for each of our [maximum - (amount to increment by)] calls.
solarradopt = Custom[solarradopt](family_instance=select_family_instance, parameter=string, amount_to_increment_by=number, maximum_base_case=number_2, current_parameter_value=number_3, accumulated_parameter_values_and_solar_data=list, path_to_solar_data=filename, file_watcher_object=watch_file)
# note: The last step is to set the model to the last parameter value we held onto, this will be the best solution from our list of runs
solarradupdate = Custom[solarradupdate](family_instance=select_family_instance, parameter=string, result=solarradopt)
