# Dynamo graph Brute Forcing Parameters and Rendering.dyn (Dynamo 0.6.3.38003)

# note: This Function updates the parameters before starting a rendering - mapping over the sequence below - FORMAT IS:
# [family instance, [param01,val][param02...,val]iteraton]
updateparameter_s = Custom[UpdateParameter(s)]()  # [familyinstance, [parameter1,val][parameter2,val] iteration number]
# note: This python node is finding the current sample path and then appending the weather data file path we've input into it.  THIS CAN BE REPLACED with a FILE PATH node if you get your own weather file.
string = StringInput("GBS_04R20_266135.csv")
python_script = Python(string)
# ---------- python_script.python (33 lines) ----------
# Default imports
import clr
clr.AddReference('RevitAPI')
clr.AddReference('RevitAPIUI')
from Autodesk.Revit.DB import *
import Autodesk
import sys
import clr
path = r'C:\Autodesk\Dynamo\Core'
exec_path = r'C:\Autodesk\Dynamo\Core\dll'
sys.path.append(path)
sys.path.append(exec_path)
clr.AddReference('LibGNet')
from Autodesk.LibG import *
sys.path.append(r'C:\Program Files (x86)\IronPython 2.7\Lib')
from os.path import join, abspath
clr.AddReference('DynamoPython')
clr.AddReference('DynamoCore')
clr.AddReference('FScheme')
import Dynamo


weatherDataFile = IN
model = Dynamo.Utilities.dynSettings.Controller.DynamoModel;
currentFile = model.HomeSpace.FileName

samplesLoc = join(currentFile,r"..\\")
_samplesPath = abspath(samplesLoc)

weatherDataPath = join(_samplesPath,weatherDataFile)
_weatherDataPath = abspath(weatherDataPath)
#Assign your output to the OUT variable
OUT = _weatherDataPath
# ----------------------------------------
# note: Zero Intelligence in how parameters change- this is brute forcing many parameters
renderwithweatherdata_return = Custom[RenderWithWeatherData_Return List of data](weatherDataFilePath=python_script)
compose_functions = ComposeFunctions(updateparameter_s, renderwithweatherdata_return)
string_2 = StringInput("This Python Script  finds your local samples folder so renderings can be saved there.")
python_script_2 = Python(string_2)
# ---------- python_script_2.python (30 lines) ----------
# Default imports
import clr
clr.AddReference('RevitAPI')
clr.AddReference('RevitAPIUI')
from Autodesk.Revit.DB import *
import Autodesk
import sys
import clr
path = r'C:\Autodesk\Dynamo\Core'
exec_path = r'C:\Autodesk\Dynamo\Core\dll'
sys.path.append(path)
sys.path.append(exec_path)
clr.AddReference('LibGNet')
from Autodesk.LibG import *
sys.path.append(r'C:\Program Files (x86)\IronPython 2.7\Lib')
from os.path import join, abspath
clr.AddReference('DynamoPython')
clr.AddReference('DynamoCore')
clr.AddReference('FScheme')
import Dynamo
# dynamo controller
model = Dynamo.Utilities.dynSettings.Controller.DynamoModel;
# get the filepath of the main sample graph.
currentFile = model.HomeSpace.FileName
# go up one level, this is the samples path
samplesLoc = join(currentFile,r"..\\")
_samplesPath = abspath(samplesLoc)

#Assign your output to the OUT variable
OUT = _samplesPath
# ----------------------------------------
# note: extract some data from render and save an image of the extracted bitmap.  We use python to get he sample folder to save the images in
getDataFromRender_WriteImage = Custom[GetDataFromRender_WriteImage](filePath=python_script_2)
compose_functions_2 = ComposeFunctions(compose_functions, getDataFromRender_WriteImage)
# note: This is the floor in the revit sample file provided with this sample
select_face = FormElementBySelection()
# note: We plot our lighting data on the floor of our sample room, each time we render daylighting
displayDataCall = Custom[displayDataCall](face=select_face)
compose_functions_3 = ComposeFunctions(compose_functions_2, displayDataCall)
# note: This wraps up the data for us to use... but it is not the function that unrwaps it and applies it
list = NewList()
# note: associated revit file in sample folder where this graph was found
# note: Note that this graph execution will take some time as it alternates between updating revit parameters and sending off 24 renderings
select_family_type = FamilyTypeSelector(index=7)
get_family_instances_by_type = GetFamilyInstancesByType(select_family_type)
list_2 = NewList()
list_3 = NewList()
number = DoubleInput(5..20..10)
string_3 = StringInput("Width")
list_4 = NewList(index0=string_3)
cartesian_product = CartProd(list_3, number, list_4)
list_5 = NewList()
# note: this will wrap a parameter and its values into a tuple.. we can make this a function and map it to ranges of values and their associated parameters...
number_2 = DoubleInput(10..20..10)
string_4 = StringInput("Height")
list_6 = NewList(index0=string_4)
cartesian_product_2 = CartProd(list_5, number_2, list_6)
lace_longest = LaceLongest(list_2, cartesian_product, cartesian_product_2)
cartesian_product_3 = CartProd(list, get_family_instances_by_type, lace_longest)
add_index_number_list_enumerate = Python(cartesian_product_3)
# ---------- add_index_number_list_enumerate.python (25 lines) ----------
# Default imports
import clr
clr.AddReference('RevitAPI')
clr.AddReference('RevitAPIUI')
from Autodesk.Revit.DB import *
import Autodesk
import sys
import clr
path = r'C:\Autodesk\Dynamo\Core'
exec_path = r'C:\Autodesk\Dynamo\Core\dll'
sys.path.append(path)
sys.path.append(exec_path)
clr.AddReference('LibGNet')
from Autodesk.LibG import *



#The input to this node will be stored in the IN variable.
listoflists= IN

for i in range(len(listoflists)):
	list = listoflists[i]
	list.Add(i)
#Assign your output to the OUT variable
OUT = listoflists
# ----------------------------------------
map = Map(compose_functions_3, add_index_number_list_enumerate)
list_length = Length(cartesian_product_3)
watch = Watch(add_index_number_list_enumerate)
file_path = StringFilename("No file selected.")
