# Dynamo graph Brute Forcing Parameters and Rendering_facades_Plus.dyn (Dynamo 0.6.3.38003)

updateparameter_s = Custom[UpdateParameter(s)]()  # [familyinstance, [parameter1,val][parameter2,val] iteration number]
# note: This python node is finding the current sample path and then appending the weather data file path we've input into it.  THIS CAN BE REPLACED with a FILE PATH node if you get your own weather file.
string = StringInput("GBS_04R20_266135.csv")
# note: This Function updates the parameters before starting a rendering - mapping over the sequence below - FORMAT IS:
# [family instance, [param01,val][param02...,val]iteraton]
python_script = Python(string)
# ---------- python_script.python (33 lines) ----------
# Default imports
import clr
clr.AddReference('RevitAPI')
clr.AddReference('RevitAPIUI')
from Autodesk.Revit.DB import *
import Autodesk
import sys
import clr
path = r'C:\Autodesk\Dynamo\Core'
exec_path = r'C:\Autodesk\Dynamo\Core\dll'
sys.path.append(path)
sys.path.append(exec_path)
clr.AddReference('LibGNet')
from Autodesk.LibG import *
sys.path.append(r'C:\Program Files (x86)\IronPython 2.7\Lib')
from os.path import join, abspath
clr.AddReference('DynamoPython')
clr.AddReference('DynamoCore')
clr.AddReference('FScheme')
import Dynamo


weatherDataFile = IN
model = Dynamo.Utilities.dynSettings.Controller.DynamoModel;
currentFile = model.HomeSpace.FileName

samplesLoc = join(currentFile,r"..\\")
_samplesPath = abspath(samplesLoc)

weatherDataPath = join(_samplesPath,weatherDataFile)
_weatherDataPath = abspath(weatherDataPath)
#Assign your output to the OUT variable
OUT = _weatherDataPath
# ----------------------------------------
number = DoubleInput(96)
number_2 = DoubleInput(-643)
number_3 = DoubleInput(45)
XYZ = Xyz(number, number_2, number_3, lacing=Longest)
number_4 = DoubleInput(356)
number_5 = DoubleInput(-793)
XYZ_2 = Xyz(number_4, number_5, number_3, lacing=Longest)
number_6 = DoubleInput(246)
number_7 = DoubleInput(-384)
XYZ_3 = Xyz(number_6, number_7, number_3, lacing=Longest)
# note: Zero Intelligence in how parameters change- this is brute forcing many parameters
renderwithweatherdata_return = Custom[RenderWithWeatherData_Return List of data](weatherDataFilePath=python_script, bottom_left=XYZ, bottom_right=XYZ_2, top_left=XYZ_3)
compose_functions = ComposeFunctions(updateparameter_s, renderwithweatherdata_return)
string_2 = StringInput("This Python Script  finds your local samples folder so renderings can be saved there.")
python_script_2 = Python(string_2)
# ---------- python_script_2.python (30 lines) ----------
# Default imports
import clr
clr.AddReference('RevitAPI')
clr.AddReference('RevitAPIUI')
from Autodesk.Revit.DB import *
import Autodesk
import sys
import clr
path = r'C:\Autodesk\Dynamo\Core'
exec_path = r'C:\Autodesk\Dynamo\Core\dll'
sys.path.append(path)
sys.path.append(exec_path)
clr.AddReference('LibGNet')
from Autodesk.LibG import *
sys.path.append(r'C:\Program Files (x86)\IronPython 2.7\Lib')
from os.path import join, abspath
clr.AddReference('DynamoPython')
clr.AddReference('DynamoCore')
clr.AddReference('FScheme')
import Dynamo
# dynamo controller
model = Dynamo.Utilities.dynSettings.Controller.DynamoModel;
# get the filepath of the main sample graph.
currentFile = model.HomeSpace.FileName
# go up one level, this is the samples path
samplesLoc = join(currentFile,r"..\\")
_samplesPath = abspath(samplesLoc)

#Assign your output to the OUT variable
OUT = _samplesPath
# ----------------------------------------
# note: extract some data from render and save an image of the extracted bitmap.  We use python to get he sample folder to save the images in
getDataFromRender_WriteImage = Custom[GetDataFromRender_WriteImage](filePath=python_script_2)
compose_functions_2 = ComposeFunctions(compose_functions, getDataFromRender_WriteImage)
# note: This is the floor in the revit sample file provided with this sample
select_face = FormElementBySelection()  # 1 picked in the model
# note: We plot our lighting data on the floor of our sample room, each time we render daylighting
displayDataCall = Custom[displayDataCall](face=select_face)
compose_functions_3 = ComposeFunctions(compose_functions_2, displayDataCall)
# note: This wraps up the data for us to use... but it is not the function that unrwaps it and applies it
list = NewList()
# note: associated revit file in sample folder where this graph was found
# note: Note that this graph execution will take some time as it alternates between updating revit parameters and sending off 24 renderings
select_family_type = FamilyTypeSelector(index=7)
list_2 = NewList(index0=select_family_type)
list_3 = NewList()
list_4 = NewList()
number_8 = DoubleInput(.1...48..~.1)
string_3 = StringInput("spandrel_dist")
list_5 = NewList(index0=string_3)
cartesian_product = CartProd(list_4, number_8, list_5)
list_6 = NewList()
# note: this will wrap a parameter and its values into a tuple.. we can make this a function and map it to ranges of values and their associated parameters...
number_9 = DoubleInput(1..8..3)
string_4 = StringInput("fin_size_multiplier")
list_7 = NewList(index0=string_4)
cartesian_product_2 = CartProd(list_6, number_9, list_7)
cartesian_product_3 = CartProd(list_3, cartesian_product, cartesian_product_2)
cartesian_product_4 = CartProd(list, list_2, cartesian_product_3)
add_index_number_list_enumerate = Python(cartesian_product_4)
# ---------- add_index_number_list_enumerate.python (25 lines) ----------
# Default imports
import clr
clr.AddReference('RevitAPI')
clr.AddReference('RevitAPIUI')
from Autodesk.Revit.DB import *
import Autodesk
import sys
import clr
path = r'C:\Autodesk\Dynamo\Core'
exec_path = r'C:\Autodesk\Dynamo\Core\dll'
sys.path.append(path)
sys.path.append(exec_path)
clr.AddReference('LibGNet')
from Autodesk.LibG import *



#The input to this node will be stored in the IN variable.
listoflists= IN

for i in range(len(listoflists)):
	list = listoflists[i]
	list.Add(i)
#Assign your output to the OUT variable
OUT = listoflists
# ----------------------------------------
map = Map(compose_functions_3, add_index_number_list_enumerate)
watch = Watch(add_index_number_list_enumerate)
file_path = StringFilename("No file selected.")
watch_2 = Watch(number_9)
watch_3 = Watch(number_8)
watch_4 = Watch(cartesian_product_3)
list_length = Length(cartesian_product_4)
watch_5 = Watch(list_length)
