# Dynamo graph placing adaptive compoent panels to mass.dyn (Dynamo 0.6.3.38003)

applycorrectquadpanelization = Custom[applyCorrectQuadPanelization Based UV dir]()
number = DoubleInput(2)
get_from_list = GetFromList(number)
calculate_horizontal_face_width = Custom[Calculate_horizontal_face_width]()
number_2 = DoubleInput(5)
determine_uv_orientation_and = Custom[determine UV orientation and divide](V_static=number_2)
compose_functions = ComposeFunctions(calculate_horizontal_face_width, determine_uv_orientation_and)
divide_face_based_on_width = Custom[divide face based on width]()
compose_functions_2 = ComposeFunctions(compose_functions, divide_face_based_on_width)
number_3 = DoubleInput(1)
number_4 = DoubleInput(1)
uv_grid = UvGrid(arg1=number_3, arg2=number_4)
select_model_element = ModelElementSelection()  # 1 picked in the model
solid_from_element = ElementSolid(select_model_element, lacing=Longest)
explode = GeometryObjectsFromRoot(solid_from_element, lacing=Longest)
get_surface_domain = SurfaceDomain(explode, lacing=Longest)
map = Map(uv_grid, get_surface_domain)
surface_normal = NormalEvaluate(map, explode, lacing=Longest)
python_script_with_variable = Python(surface_normal, explode)  # "Python Script With Variable Number of Inputs"
# ---------- python_script_with_variable.python (29 lines) ----------
# Default imports
import clr
clr.AddReference('RevitAPI')
clr.AddReference('RevitAPIUI')
from Autodesk.Revit.DB import *
import Autodesk
import sys
import clr
path = r'C:\Autodesk\Dynamo\Core'
exec_path = r'C:\Autodesk\Dynamo\Core\dll'
sys.path.append(path)
sys.path.append(exec_path)
clr.AddReference('LibGNet')
from Autodesk.LibG import *

#The input to this node will be stored in the IN0...INX variable(s).
normlist = IN0
faces= IN1
filtered = []



for i in range(len(normlist)):
	if normlist[i][0][2] == 0:
		filtered.append(faces[i])
	

#Assign your output to the OUT variable
OUT = filtered
# ----------------------------------------
map_2 = Map(compose_functions_2, python_script_with_variable)
map_3 = Map(get_from_list, map_2)
number_5 = DoubleInput(0)
get_from_list_2 = GetFromList(number_5)
map_4 = Map(get_from_list_2, map_2)
number_6 = DoubleInput(1)
get_from_list_3 = GetFromList(number_6)
map_5 = Map(get_from_list_3, map_2)
lace_shortest = LaceShortest(applycorrectquadpanelization, map_3, map_4, map_5)
number_7 = DoubleInput(1)
flatten = FlattenListAmt(lace_shortest, number_7)
select_family_type = FamilyTypeSelector(index=7)
adaptive_component_by_xyzs = AdaptiveComponentByPoints(flatten, select_family_type, lacing=Longest)
get_family_parameter = FamilyInstanceParameterSelector()
number_8 = DoubleInput(0.3)
set_element_parameter = FamilyInstanceParameterSetter(arg1=get_family_parameter, arg2=number_8, lacing=Longest)
watch_3d = Watch3D(flatten)
