# Dynamo graph hill_climbing_daylighting_Facades_Plus.dyn (Dynamo 0.6.3.38003)

number = DoubleInput(0.05)
number_2 = DoubleInput(0.45)
list = NewList(index0=number, index1=number_2)
string = StringInput("spandrel_dist")
list_2 = NewList(index0=list, index1=string)
number_3 = DoubleInput(1)
number_4 = DoubleInput(8)
list_3 = NewList(index0=number_3, index1=number_4)
string_2 = StringInput("fin_size_multiplier")
list_4 = NewList(index0=list_3, index1=string_2)
number_5 = DoubleInput(0.5)
number_6 = DoubleInput(1)
list_5 = NewList(index0=number_5, index1=number_6)
string_3 = StringInput("frame_size")
list_6 = NewList(index0=list_5, index1=string_3)
list_7 = NewList(index0=list_2, index1=list_4, index2=list_6)
watch = Watch(list_7)
number_7 = DoubleInput(0)
select_family_type = FamilyTypeSelector(index=7)
list_8 = NewList(index0=select_family_type)
make_daylight_param_parent = Custom[Make Daylight param parent vector](list_of_parameters_and_ranges=list_7, generation_number=number_7, list_of_family_instances=list_8)
watch_2 = Watch(make_daylight_param_parent)
select_face = FormElementBySelection()  # 1 picked in the model
number_8 = DoubleInput(246)
number_9 = DoubleInput(-384)
number_10 = DoubleInput(43)
XYZ = Xyz(number_8, number_9, number_10, lacing=Longest)
number_11 = DoubleInput(96)
number_12 = DoubleInput(-643)
XYZ_2 = Xyz(number_11, number_12, number_10, lacing=Longest)
number_13 = DoubleInput(356)
number_14 = DoubleInput(-793)
XYZ_3 = Xyz(number_13, number_14, number_10, lacing=Longest)
evaluate_daylighting_solution = Custom[Evaluate Daylighting Solution](solution=make_daylight_param_parent, face_to_analyze_daylight_on=select_face, top_left=XYZ, bottom_left=XYZ_2, bottom_right=XYZ_3)
watch_3 = Watch(evaluate_daylighting_solution)
number_15 = DoubleInput(0.2)
produce_new_daylight_child = Custom[Produce New DayLight Child](parent_fit=evaluate_daylighting_solution, family_instances=list_8, parent=make_daylight_param_parent, mutation_rate=number_15, top_left=XYZ, bottom_left=XYZ_2, bottom_right=XYZ_3, face_to_analyze_daylight_on=select_face, parameters_and_ranges=list_7)
watch_4 = Watch(produce_new_daylight_child)
list_9 = NewList(index0=XYZ_2, index1=XYZ_3, index2=XYZ, index3=select_face)
watch_3d = Watch3D(list_9)
