# Dynamo custom node Calculate_horizontal_face_width.dyf (Dynamo 0.6.3.38003)
# category: Misc

faces_to_calculate_horizontal_lengths_fo = Input(faces to calculate horizontal lengths for)
number = DoubleInput(0)
get_surface_domain = SurfaceDomain(faces_to_calculate_horizontal_lengths_fo, lacing=Longest)
number_2 = DoubleInput(1)
uv_grid = UvGrid(get_surface_domain, number_2, number_2)
evaluate_surface = XyzEvaluate(uv_grid, faces_to_calculate_horizontal_lengths_fo, lacing=Longest)
python_script = Python(evaluate_surface)
# ---------- python_script.python (27 lines) ----------
# Default imports
import clr
clr.AddReference('RevitAPI')
clr.AddReference('RevitAPIUI')
from Autodesk.Revit.DB import *
import Autodesk
import sys
import clr
path = r'C:\Autodesk\Dynamo\Core'
exec_path = r'C:\Autodesk\Dynamo\Core\dll'
sys.path.append(path)
sys.path.append(exec_path)
clr.AddReference('LibGNet')
from Autodesk.LibG import *


#The input to this node will be stored in the IN variable.
xyzs = IN
zs = []
firstz = xyzs[0]
xyzList = [firstz]

for xyz in xyzs:
	if xyz.Z == firstz.Z and xyz not in zs:
		zs.append(xyz)
#Assign your output to the OUT variable
OUT = zs
# ----------------------------------------
get_from_list = GetFromList(number, python_script)
number_3 = DoubleInput(1)
get_from_list_2 = GetFromList(number_3, python_script)
xyz_distance = XyzDistance(get_from_list, get_from_list_2, lacing=Longest)
number_4 = DoubleInput(50)
divide = Division(xyz_distance, number_4, lacing=Longest)
ceiling = Ceiling(divide, lacing=Longest)
length = LengthInput(0.3048)
divide_2 = Division(ceiling, length, lacing=Longest)
number_5 = DoubleInput(1)
add = Addition(divide_2, number_5, lacing=Longest)
python_script_2 = Python(add)
# ---------- python_script_2.python (23 lines) ----------
# Default imports
import clr
clr.AddReference('RevitAPI')
clr.AddReference('RevitAPIUI')
from Autodesk.Revit.DB import *
import Autodesk
import sys
import clr
path = r'C:\Autodesk\Dynamo\Core'
exec_path = r'C:\Autodesk\Dynamo\Core\dll'
sys.path.append(path)
sys.path.append(exec_path)
clr.AddReference('LibGNet')
from Autodesk.LibG import *

#The input to this node will be stored in the IN variable.
number = IN

if number %2 != 0:
	number = number - 1

#Assign your output to the OUT variable
OUT = number
# ----------------------------------------
list = NewList(index0=faces_to_calculate_horizontal_lengths_fo, index1=python_script_2)
data_list_face_length = Output(list)  # "data list [face,length]"
watch = Watch(evaluate_surface)
watch_2 = Watch(python_script)
