# Dynamo custom node Display Daylighting Data On Surface.dyf (Dynamo 0.6.3.38003)
# category: Daylight
# Displays daylighting data on a surface, requires manually setting up surface analysis display style through revit.  Also requires wrapping with a transaction node.

number = DoubleInput(1)
get_from_list = GetFromList(number)
face = Input()
xyz_sample_points = Input()
data = Input()
python_script_with_variable = Python(face, xyz_sample_points, data)  # "Python Script With Variable Number of Inputs"
# ---------- python_script_with_variable.python (29 lines) ----------
# Default imports
import clr
clr.AddReference('RevitAPI')
clr.AddReference('RevitAPIUI')
from Autodesk.Revit.DB import *
import Autodesk
import sys
import clr
path = r'C:\Autodesk\Dynamo\Core'
exec_path = r'C:\Autodesk\Dynamo\Core\dll'
sys.path.append(path)
sys.path.append(exec_path)
clr.AddReference('LibGNet')
from Autodesk.LibG import *

#The input to this node will be stored in the IN0...INX variable(s).
face = IN0
points = IN1
illum = IN2
outpairs = []

zippeddata =  zip(illum,points)

for pair in zippeddata:
	intersec = face.Project(pair[1])
	if intersec is not None:
		outpairs.append([intersec.UVPoint,pair[0]])
#Assign your output to the OUT variable
OUT = outpairs
# ----------------------------------------
map = Map(get_from_list, python_script_with_variable)
number_2 = DoubleInput(0)
get_from_list_2 = GetFromList(number_2)
map_2 = Map(get_from_list_2, python_script_with_variable)
number_3 = DoubleInput(1)
analysis_display_manager = SpatialFieldManager(number_3, lacing=Longest)
display_analysis_surface = SpatialFieldFace(map, map_2, analysis_display_manager, face)
watch = Watch(analysis_display_manager)
