# Dynamo custom node Evaluate Daylighting Solution.dyf (Dynamo 0.6.3.38003)
# category: Misc

number = DoubleInput(500)
number_2 = DoubleInput(5400)
within_range = Custom[Within Range](greater_than=number, less_than=number_2)
number_3 = DoubleInput(6)
solution = Input()
updateparameter_s = Custom[UpdateParameter(s)](seq=solution)  # [familyinstance, [parameter1,val][parameter2,val] iteration number]
string = StringInput("GBS_04R20_266135.csv")
python_script = Python(string)
# ---------- python_script.python (33 lines) ----------
# Default imports
import clr
clr.AddReference('RevitAPI')
clr.AddReference('RevitAPIUI')
from Autodesk.Revit.DB import *
import Autodesk
import sys
import clr
path = r'C:\Autodesk\Dynamo\Core'
exec_path = r'C:\Autodesk\Dynamo\Core\dll'
sys.path.append(path)
sys.path.append(exec_path)
clr.AddReference('LibGNet')
from Autodesk.LibG import *
sys.path.append(r'C:\Program Files (x86)\IronPython 2.7\Lib')
from os.path import join, abspath
clr.AddReference('DynamoPython')
clr.AddReference('DynamoCore')
clr.AddReference('FScheme')
import Dynamo


weatherDataFile = IN
model = Dynamo.Utilities.dynSettings.Controller.DynamoModel;
currentFile = model.HomeSpace.FileName

samplesLoc = join(currentFile,r"..\\")
_samplesPath = abspath(samplesLoc)

weatherDataPath = join(_samplesPath,weatherDataFile)
_weatherDataPath = abspath(weatherDataPath)
#Assign your output to the OUT variable
OUT = _weatherDataPath
# ----------------------------------------
bottom_left = Input()
bottom_right = Input()
top_left = Input()
renderwithweatherdata_return = Custom[RenderWithWeatherData_Return List of data](iteration=updateparameter_s, weatherDataFilePath=python_script, bottom_left=bottom_left, bottom_right=bottom_right, top_left=top_left)
get_from_list = GetFromList(number_3, renderwithweatherdata_return)
number_4 = DoubleInput(3)
get_from_list_2 = GetFromList(number_4, renderwithweatherdata_return)
face_to_analyze_daylight_on = Input()
filter_lighting_data_by_face = Custom[Filter Lighting Data by Face](xyz_sample_points=get_from_list, data=get_from_list_2, face=face_to_analyze_daylight_on)
filter = Filter(within_range, filter_lighting_data_by_face)
list_length = Length(filter)
list_length_2 = Length(filter_lighting_data_by_face)
divide = Division(list_length, list_length_2, lacing=Longest)
percentage_of_samples_within_range = Output(divide)
watch = Watch(list_length)
watch_2 = Watch(list_length_2)
watch_3 = Watch(filter)
watch_4 = Watch(updateparameter_s)
watch_5 = Watch(renderwithweatherdata_return)
string_2 = StringInput("This Python Script  finds your local samples folder so renderings can be saved there.")
python_script_2 = Python(string_2)
# ---------- python_script_2.python (30 lines) ----------
# Default imports
import clr
clr.AddReference('RevitAPI')
clr.AddReference('RevitAPIUI')
from Autodesk.Revit.DB import *
import Autodesk
import sys
import clr
path = r'C:\Autodesk\Dynamo\Core'
exec_path = r'C:\Autodesk\Dynamo\Core\dll'
sys.path.append(path)
sys.path.append(exec_path)
clr.AddReference('LibGNet')
from Autodesk.LibG import *
sys.path.append(r'C:\Program Files (x86)\IronPython 2.7\Lib')
from os.path import join, abspath
clr.AddReference('DynamoPython')
clr.AddReference('DynamoCore')
clr.AddReference('FScheme')
import Dynamo
# dynamo controller
model = Dynamo.Utilities.dynSettings.Controller.DynamoModel;
# get the filepath of the main sample graph.
currentFile = model.HomeSpace.FileName
# go up one level, this is the samples path
samplesLoc = join(currentFile,r"..\\")
_samplesPath = abspath(samplesLoc)

#Assign your output to the OUT variable
OUT = _samplesPath
# ----------------------------------------
getDataFromRender_WriteImage = Custom[GetDataFromRender_WriteImage](list=renderwithweatherdata_return, filePath=python_script_2)
watch_6 = Watch(python_script_2)
watch_7 = Watch(divide)
