# Dynamo custom node Make Daylight param parent vector.dyf (Dynamo 0.6.3.38003)
# category: Misc

list_of_family_instances = Input()
list_length = Length(list_of_family_instances)
number = DoubleInput(1)
subtract = Subtraction(list_length, number, lacing=Longest)
random_number = Random()
# note: this selects a random item from a list...this is useful for changing a random family instance
multiply = Multiplication(subtract, random_number, lacing=Longest)
round = Round(multiply, lacing=Longest)
get_from_list = GetFromList(round, list_of_family_instances)
list_of_parameters_and_ranges = Input()
number_2 = DoubleInput(0)
number_3 = DoubleInput(1)
# note: for each value we remap it within the range specified
remapVal = Custom[RemapVal](in_min=number_2, in_max=number_3)
apply_function_to_list = ApplyList(remapVal)
add_to_list = List()
# note: get each range and generate a ranndom number from 0 to 1
python_script = Python()
# ---------- python_script.python (22 lines) ----------
# Default imports
import clr
clr.AddReference('RevitAPI')
clr.AddReference('RevitAPIUI')
from Autodesk.Revit.DB import *
import Autodesk
import sys
import clr
path = r'C:\Autodesk\Dynamo\Core'
exec_path = r'C:\Autodesk\Dynamo\Core\dll'
sys.path.append(path)
sys.path.append(exec_path)
clr.AddReference('LibGNet')
from Autodesk.LibG import *
sys.path.append(r'C:\Program Files (x86)\IronPython 2.7\Lib')
import random
#The input to this node will be stored in the IN variable.
nothing = IN

num = random.uniform(0,1)
#Assign your output to the OUT variable
OUT = num
# ----------------------------------------
number_4 = DoubleInput(0)
get_from_list_2 = GetFromList(number_4)
map = Map(get_from_list_2, list_of_parameters_and_ranges)
map_2 = Map(python_script, map)
# note: add it the the start of the list of each range
combine = Combine(add_to_list, map_2, map)
map_3 = Map(apply_function_to_list, combine)
python_script_with_variable = Python(list_of_parameters_and_ranges, map_3)  # "Python Script With Variable Number of Inputs"
# ---------- python_script_with_variable.python (24 lines) ----------
# Default imports
import clr
clr.AddReference('RevitAPI')
clr.AddReference('RevitAPIUI')
from Autodesk.Revit.DB import *
import Autodesk
import sys
import clr
path = r'C:\Autodesk\Dynamo\Core'
exec_path = r'C:\Autodesk\Dynamo\Core\dll'
sys.path.append(path)
sys.path.append(exec_path)
clr.AddReference('LibGNet')
from Autodesk.LibG import *

#The input to this node will be stored in the IN0...INX variable(s).
paramVector = IN0
randomNums = IN1

for i in range(len(paramVector)):
	paramVector[i][0] = randomNums[i]

#Assign your output to the OUT variable
OUT = paramVector
# ----------------------------------------
list = NewList(index0=python_script_with_variable)
add_to_list_2 = List(get_from_list, list)
generation_number = Input()
list_2 = NewList(index0=generation_number)
join_lists = Append(add_to_list_2, list_2)
parent_vector = Output(join_lists)
watch = Watch(combine)
watch_2 = Watch(map_2)
# note: extract the ranges
watch_3 = Watch(map)
