# Dynamo custom node Mutate Parent Daylight.dyf (Dynamo 0.6.3.38003)
# category: Misc

parent = Input()
python_script = Python()
# ---------- python_script.python (22 lines) ----------
# Default imports
import clr
clr.AddReference('RevitAPI')
clr.AddReference('RevitAPIUI')
from Autodesk.Revit.DB import *
import Autodesk
import sys
import clr
path = r'C:\Autodesk\Dynamo\Core'
exec_path = r'C:\Autodesk\Dynamo\Core\dll'
sys.path.append(path)
sys.path.append(exec_path)
clr.AddReference('LibGNet')
from Autodesk.LibG import *
sys.path.append(r'C:\Program Files (x86)\IronPython 2.7\Lib')
import random
#The input to this node will be stored in the IN variable.
nothing = IN

num = random.uniform(-1,1)
#Assign your output to the OUT variable
OUT = num
# ----------------------------------------
mutation_rate = Input()
multiply = Multiplication(mutation_rate, lacing=Longest)
compose_functions = ComposeFunctions(python_script, multiply)
number = DoubleInput(0)
get_from_list = GetFromList(number)
number_2 = DoubleInput(1)
get_from_list_2 = GetFromList(number_2, parent)
map = Map(get_from_list, get_from_list_2)
map_2 = Map(compose_functions, map)
number_3 = DoubleInput(0)
get_from_list_3 = GetFromList(number_3)
paramaters_and_ranges = Input()
map_3 = Map(get_from_list_3, paramaters_and_ranges)
# note: Add Random vectors and current state new state = randomnum * mutation rate * range
python_script_with_variable = Python(parent, map_2, map_3)  # "Python Script With Variable Number of Inputs"
# ---------- python_script_with_variable.python (38 lines) ----------
# Default imports
import clr
clr.AddReference('RevitAPI')
clr.AddReference('RevitAPIUI')
from Autodesk.Revit.DB import *
import Autodesk
import sys
import clr
path = r'C:\Autodesk\Dynamo\Core'
exec_path = r'C:\Autodesk\Dynamo\Core\dll'
sys.path.append(path)
sys.path.append(exec_path)
clr.AddReference('LibGNet')
from Autodesk.LibG import *
import math
#The input to this node will be stored in the IN0...INX variable(s).
parent = IN0
randomvector = IN1
ranges = IN2
paramlist = parent[1]

#for i in range(len(paramlist)):
#	paramlist[i][0] =  max(1,paramlist[i][0] + randomvector[i])

def clamp(n, minn, maxn):
    if n < minn:
        return minn
    elif n > maxn:
        return maxn
    else:
        return n

for i in range(len(paramlist)):
	range = ranges[i][1] - ranges[i][0]
	paramlist[i][0] = clamp( paramlist[i][0] + range*randomvector[i], ranges[i][0], ranges[i][1])

#Assign your output to the OUT variable
OUT = parent
# ----------------------------------------
family_instances = Input()
list_length = Length(family_instances)
number_4 = DoubleInput(1)
subtract = Subtraction(list_length, number_4, lacing=Longest)
random_number = Random()
multiply_2 = Multiplication(subtract, random_number, lacing=Longest)
round = Round(multiply_2, lacing=Longest)
get_from_list_4 = GetFromList(round, family_instances)
python_script_with_variable_2 = Python(python_script_with_variable, get_from_list_4)  # "Python Script With Variable Number of Inputs"
# ---------- python_script_with_variable_2.python (23 lines) ----------
# Default imports
import clr
clr.AddReference('RevitAPI')
clr.AddReference('RevitAPIUI')
from Autodesk.Revit.DB import *
import Autodesk
import sys
import clr
path = r'C:\Autodesk\Dynamo\Core'
exec_path = r'C:\Autodesk\Dynamo\Core\dll'
sys.path.append(path)
sys.path.append(exec_path)
clr.AddReference('LibGNet')
from Autodesk.LibG import *

#The input to this node will be stored in the IN0...INX variable(s).
parent = IN0
fi = IN1

parent[0] = fi

#Assign your output to the OUT variable
OUT = parent
# ----------------------------------------
python_script_2 = Python(python_script_with_variable_2)
# ---------- python_script_2.python (20 lines) ----------
# Default imports
import clr
clr.AddReference('RevitAPI')
clr.AddReference('RevitAPIUI')
from Autodesk.Revit.DB import *
import Autodesk
import sys
import clr
path = r'C:\Autodesk\Dynamo\Core'
exec_path = r'C:\Autodesk\Dynamo\Core\dll'
sys.path.append(path)
sys.path.append(exec_path)
clr.AddReference('LibGNet')
from Autodesk.LibG import *

#The input to this node will be stored in the IN variable.
parent = IN
parent[2] = parent[2] + 1
#Assign your output to the OUT variable
OUT = parent
# ----------------------------------------
mutated_parent = Output(python_script_2)
watch = Watch(map_3)
watch_2 = Watch(map_2)
watch_3 = Watch(python_script_with_variable)
