# Dynamo custom node RenderWithWeatherData_Return List of data.dyf (Dynamo 0.6.3.38003)
# category: Misc

string = StringInput("{3D}")
number = DoubleInput(200)
weatherDataFilePath = Input()
number_2 = DoubleInput(16)
number_3 = DoubleInput(5)
dateTime = MakeDateTime(arg3=number_2, arg6=number_3, lacing=Longest)
parse_weather_data = Custom[Parse Weather Data](WeatherDataFilePath=weatherDataFilePath, dateTimeObject=dateTime)
number_4 = DoubleInput(42)
number_5 = DoubleInput(-74)
create_skymodel_and_environment = Custom[Create Skymodel and Environment](DNI=parse_weather_data.DNI, GHI=parse_weather_data.GHI, DHI=parse_weather_data.DHI, loc_x=number_4, loc_y=number_5, datatime_object=dateTime)  # Creates a skymodel and environment for daylight render, returns the environment object
bottom_left = Input()
bottom_right = Input()
top_left = Input()
create_cloud_daylight_job_and = Custom[Create Cloud Daylight Job and Send](viewname=string, xDivisions=number, environment=create_skymodel_and_environment, bottom_left=bottom_left, bottom_right=bottom_right, top_left=top_left)  # Create and Send Cloud Daylight Job
first_of_list = First(create_cloud_daylight_job_and)
parse_daylighting_file = ParseSDF(first_of_list, lacing=Longest)
number_6 = DoubleInput(0)
number_slider = DoubleSliderInput(5000, range=0..120000)
get_daylighting_grid_image = GetDaylightingForegroundImage(parse_daylighting_file, number_6, number_slider, lacing=Longest)
watch_image = WatchImage(get_daylighting_grid_image)
file_path = StringFilename("No file selected.")
get_daylighting_grid_colors = GetDaylightingColors(parse_daylighting_file, number_6, number_slider, lacing=Longest)
get_daylighting_grid_illuminance = GetDaylightingIlluminanceValues(parse_daylighting_file, number_6, lacing=Longest)  # "Get Daylighting Grid Illuminance Values"
illuminance_to_srgb = IlluminanceToSRGB(get_daylighting_grid_illuminance, lacing=Longest)
get_daylighting_grid_resolution = GetSDFResolution(parse_daylighting_file, number_6, lacing=Longest)
iteration = Input()
get_daylighting_grid_positions = GetDaylightingPositions(parse_daylighting_file, number_6, lacing=Longest)
list = NewList(index0=get_daylighting_grid_image, index1=get_daylighting_grid_colors, index2=get_daylighting_grid_illuminance, index3=illuminance_to_srgb, index4=get_daylighting_grid_resolution, index5=iteration, index6=get_daylighting_grid_positions)
Render_Data = Output(list)
watch = Watch(dateTime)
watch_2 = Watch(create_skymodel_and_environment)
watch_3 = Watch(create_cloud_daylight_job_and)
