# Dynamo custom node Surface Area_dividedby_Solar Value.dyf (Dynamo 0.6.3.38003)
# category: Analyze.Solar
# divides the gross surface area by the solar value

element_to_get_surface_area_from = Input()
string = StringInput("Gross Surface Area")
get_element_parameter_value = FamilyInstanceParameterGetter(element_to_get_surface_area_from, string, lacing=Longest)
length = LengthInput(0.3048)
divide = Division(get_element_parameter_value, length, lacing=Longest)
length_2 = LengthInput(0.3048)
divide_2 = Division(divide, length_2, lacing=Longest)
solar_value = Input()
divide_3 = Division(divide_2, solar_value, lacing=Longest)
x_y = Output(divide_3)  # "x÷y"
