# Dynamo custom node UpdateParameter(s).dyf (Dynamo 0.6.3.38003)
# category: Misc
# [familyinstance, [parameter1,val][parameter2,val] iteration number]

seq = Input()
# note: family instance
first_of_list = First(seq)
set_family_instance_parameter = FamilyInstanceParameterSetter(first_of_list, lacing=Longest)
# note: iteration number
last_of_list = Last(seq)
Output = Output(last_of_list)  # ""
python_script = Python(seq)
# ---------- python_script.python (25 lines) ----------
# Default imports
import clr
clr.AddReference('RevitAPI')
clr.AddReference('RevitAPIUI')
from Autodesk.Revit.DB import *
import Autodesk
import sys
import clr
path = r'C:\Autodesk\Dynamo\Core'
exec_path = r'C:\Autodesk\Dynamo\Core\dll'
sys.path.append(path)
sys.path.append(exec_path)
clr.AddReference('LibGNet')
from Autodesk.LibG import *

#The input to this node will be stored in the IN variable.
ArgList = IN

listOfLists = []

for item in ArgList:
		if hasattr(item,'__iter__'):
			listOfLists.append(item)
OUT = listOfLists
	
# ----------------------------------------
number = DoubleInput(1)
flatten = FlattenListAmt(python_script, number)
watch = Watch(flatten)
set_family_type_parameter = FamilyTypeParameterSetter(first_of_list, lacing=Longest)
# note: parameter name
last_of_list_2 = Last()
map = Map(last_of_list_2, flatten)
# note: value
first_of_list_2 = First()
map_2 = Map(first_of_list_2, flatten)
lace_longest = LaceLongest(set_family_type_parameter, map, map_2)
transaction = Transaction(lace_longest)
watch_2 = Watch(lace_longest)
