# Dynamo custom node applyCorrectDivision Based UV dir.dyf (Dynamo 0.6.3.38003)
# category: Misc

number = DoubleInput(0)
faces_to_calculate_horizontal_lengths_fo = Input(faces to calculate horizontal lengths for)
get_surface_domain = SurfaceDomain(faces_to_calculate_horizontal_lengths_fo, lacing=Longest)
number_2 = DoubleInput(1)
uv_grid = UvGrid(get_surface_domain, number_2, number_2)
evaluate_surface = XyzEvaluate(uv_grid, faces_to_calculate_horizontal_lengths_fo, lacing=Longest)
python_script = Python(evaluate_surface)
# ---------- python_script.python (27 lines) ----------
# Default imports
import clr
clr.AddReference('RevitAPI')
clr.AddReference('RevitAPIUI')
from Autodesk.Revit.DB import *
import Autodesk
import sys
import clr
path = r'C:\Autodesk\Dynamo\Core'
exec_path = r'C:\Autodesk\Dynamo\Core\dll'
sys.path.append(path)
sys.path.append(exec_path)
clr.AddReference('LibGNet')
from Autodesk.LibG import *


#The input to this node will be stored in the IN variable.
xyzs = IN
zs = []
firstz = xyzs[0]
xyzList = [firstz]

for xyz in xyzs:
	if xyz.Z == firstz.Z and xyz not in zs:
		zs.append(xyz)
#Assign your output to the OUT variable
OUT = zs
# ----------------------------------------
get_from_list = GetFromList(number, python_script)
number_3 = DoubleInput(1)
get_from_list_2 = GetFromList(number_3, python_script)
xyz_distance = XyzDistance(get_from_list, get_from_list_2, lacing=Longest)
horizontal_length = Output(xyz_distance)
watch = Watch(evaluate_surface)
watch_2 = Watch(python_script)
