# Dynamo custom node applyCorrectQuadPanelization Based UV dir.dyf (Dynamo 0.6.3.38003)
# category: Misc

seq = Input()
watch = Watch(seq)
python_script = Python(seq)
# ---------- python_script.python (24 lines) ----------
# Default imports
import clr
clr.AddReference('RevitAPI')
clr.AddReference('RevitAPIUI')
from Autodesk.Revit.DB import *
import Autodesk
import sys
import clr
path = r'C:\Autodesk\Dynamo\Core'
exec_path = r'C:\Autodesk\Dynamo\Core\dll'
sys.path.append(path)
sys.path.append(exec_path)
clr.AddReference('LibGNet')
from Autodesk.LibG import *

#The input to this node will be stored in the IN variable.
roworcol = IN

if roworcol[0].Z == roworcol[1].Z:
	out = 0
else:
	out = 1
#Assign your output to the OUT variable
OUT = out
# ----------------------------------------
Row_Number_non_rotated = Input()
quads_from_rectangular_grid = Custom[Quads from Rectangular Grid](Row_Number=Row_Number_non_rotated, Point_List=seq)  # Given a grid of points (xyz or uv) create a list of quadrilaterals
Row_Number_rotated = Input()
number = DoubleInput(1)
add = Addition(Row_Number_non_rotated, number, lacing=Longest)
partition_list = Slice(seq, add)
transpose_lists = Transpose(partition_list)
quads_from_rectangular_grid_2 = Custom[Quads from Rectangular Grid](Row_Number=Row_Number_rotated, Point_List=transpose_lists)
if_ = Conditional(python_script, quads_from_rectangular_grid, quads_from_rectangular_grid_2)
result = Output(if_)
watch_2 = Watch(transpose_lists)
reverse = Reverse()
map = Map(reverse, transpose_lists)
watch_3 = Watch(map)
watch_4 = Watch(python_script)
watch_5 = Watch(partition_list)
