# Dynamo custom node determine UV orientation and divide.dyf (Dynamo 0.6.3.38003)
# category: Misc

number = DoubleInput(0)
data_list = Input()
get_from_list = GetFromList(number, data_list)
get_surface_domain = SurfaceDomain(get_from_list, lacing=Longest)
number_2 = DoubleInput(1)
uv_grid = UvGrid(get_surface_domain, number_2, number_2)
evaluate_surface = XyzEvaluate(uv_grid, get_from_list, lacing=Longest)
python_script = Python(evaluate_surface)
# ---------- python_script.python (24 lines) ----------
# Default imports
import clr
clr.AddReference('RevitAPI')
clr.AddReference('RevitAPIUI')
from Autodesk.Revit.DB import *
import Autodesk
import sys
import clr
path = r'C:\Autodesk\Dynamo\Core'
exec_path = r'C:\Autodesk\Dynamo\Core\dll'
sys.path.append(path)
sys.path.append(exec_path)
clr.AddReference('LibGNet')
from Autodesk.LibG import *

#The input to this node will be stored in the IN variable.
roworcol = IN

if roworcol[0].Z == roworcol[1].Z:
	out = 0
else:
	out = 1
#Assign your output to the OUT variable
OUT = out
# ----------------------------------------
watch = Watch(python_script)
number_3 = DoubleInput(1)
get_from_list_2 = GetFromList(number_3, data_list)
V_static = Input()
list = NewList(index0=get_from_list_2, index1=V_static)
list_2 = NewList(index0=V_static, index1=get_from_list_2)
if_ = Conditional(python_script, list, list_2)
list_3 = NewList(index0=get_from_list, index1=if_)
face_U_V = Output(list_3)  # "[face.[U,V]]"
