# Dynamo custom node divide face based on width.dyf (Dynamo 0.6.3.38003)
# category: Misc

number = DoubleInput(0)
data_list = Input()
get_from_list = GetFromList(number, data_list)
get_surface_domain = SurfaceDomain(get_from_list, lacing=Longest)
number_2 = DoubleInput(0)
number_3 = DoubleInput(1)
get_from_list_2 = GetFromList(number_3, data_list)
get_from_list_3 = GetFromList(number_2, get_from_list_2)
to_string = ToString(get_from_list_3)
string_to_number = String2Num(to_string, lacing=Longest)
number_4 = DoubleInput(1)
get_from_list_4 = GetFromList(number_4, get_from_list_2)
uv_grid = UvGrid(get_surface_domain, string_to_number, get_from_list_4)
evaluate_surface = XyzEvaluate(uv_grid, get_from_list, lacing=Longest)
list = NewList(index0=evaluate_surface, index1=string_to_number, index2=get_from_list_4)
XYZs_U_V = Output(list)  # "XYZs,U,V"
watch_3d = Watch3D(evaluate_surface)
watch = Watch(uv_grid)
