# Dynamo custom node solarradcomp.dyf (Dynamo 0.6.3.31046)
# category: Analyze.Solar

# note: The new data [solar data]
data = Input()
watch = Watch(data)
string = StringInput("comparing old data:  ")
# note: The old list we have been accumulating
old = Input()
# note: This comparison is the important part of this node, we check if the first of list [solar data, param val] is greater than the data we just got back in our newest run.
first_of_list = First(old)
to_string = ToString(first_of_list)
string_2 = StringInput("to new data : ")
to_string_2 = ToString(data)
concat_strings = ConcatStrings(s3=string, s4=to_string, string_2, to_string_2)
dynamologger_log = Custom[DynamoLogger.Log()](input=concat_strings)  # Uses the DynamoLogger and FSchemeInterop Utils class to print to the console
greater_than = GreaterThan(first_of_list, data)
debug_breakpoint = Breakpoint(greater_than)
# note: These perform all flow controls let us print to the console before continuing with graph execution, they output their last input
perform_all = Begin(expr1=dynamologger_log, expr2=debug_breakpoint)
string_3 = StringInput("Previous data was greater, keeping previous data ")
dynamologger_log_2 = Custom[DynamoLogger.Log()](input=string_3)
perform_all_2 = Begin(expr1=dynamologger_log_2, expr2=old)
string_4 = StringInput("Previous data was less than new data, keeping new data")
# note: In addition to passing the correct data out of this node, we also print a different message to the console
dynamologger_log_3 = Custom[DynamoLogger.Log()](input=string_4)
# note: The new parameter value[param value] for the current data
newAmt = Input()
list = NewList(index0=data, index1=newAmt)
perform_all_3 = Begin(expr1=dynamologger_log_3, expr2=list)
# note: This if statement executes one of two branches depending on if the greater than test was true or false
if_ = Conditional(perform_all, perform_all_2, perform_all_3)
result = Output(if_)
