# Dynamo custom node solarradopt.dyf (Dynamo 0.6.3.31046)
# category: Analyze.Solar

maximum_base_case = Input()  # "maximum(base_case)"
current_parameter_value = Input()
greaterthanequals = GreaterThanEquals(maximum_base_case, current_parameter_value)
file_watcher_object = Input()
# note: first thing, we need to reset the file watcher for this iteration so we can tell when the solar calculation is done.
reset_file_watcher = FileWatcherReset(file_watcher_object)
family_instance = Input()
parameter = Input()
# note: next update the revit model to the current state of the variable "parameter_value" you'll see that we increment this on each iteration by amount to increment by
set_element_parameter = FamilyInstanceParameterSetter(family_instance, parameter, current_parameter_value, lacing=Longest)
transaction = Transaction(set_element_parameter)
# note: time in milliseconds that we wait for the solar analysis to complete, if you get errors in the console "file watcher timed out" then try increasing this time.  This is machine dependent.
number = DoubleInput(4000)
# note: Now, we need to make sure that the solar analysis from Vasari has actualiy completed and saved our new solar data to the CSV where we are looking for it. When this node detects the file being resaved, it will fire and we can move to the next expression in"Perform All"
wait_for_change = FileWatcherWait(file_watcher_object, number)
number_2 = DoubleInput(100)
pause = Pause(number_2)
amount_to_increment_by = Input()
# note: this addition node actually increments the parameter variable
add = Addition(amount_to_increment_by, current_parameter_value, lacing=Longest)
accumulated_parameter_values_and_solar_d = Input(accumulated_parameter_values_and_solar_data)
string = StringInput("Gross Surface Area")
get_element_parameter_value = FamilyInstanceParameterGetter(transaction, string, lacing=Longest)
length = LengthInput(0.3048)
divide = Division(get_element_parameter_value, length, lacing=Longest)
length_2 = LengthInput(0.3048)
divide_2 = Division(divide, length_2, lacing=Longest)
path_to_solar_data = Input()
# note: These nodes just parse the exported solar data from vasari and sum all of the data inside to get the total solar radiation for the current run
read_file = FileReader(path_to_solar_data)
extract_solar_radiation_value = ComputeSolarRadiationValue(read_file)
divide_3 = Division(divide_2, extract_solar_radiation_value, lacing=Longest)
transaction_2 = Transaction(divide_3)
# note: this custom node is basically a simple if statement, if the new solar data was greater than the last one, we replace our last max data with this new one, if the solar data was less, we just keep our old data.
solarradcomp = Custom[solarradcomp](old=accumulated_parameter_values_and_solar_d, data=transaction_2, newAmt=current_parameter_value)
# note: Finally, we start doing some actual work, this is a recursive call, where the increment variable is incremented by adding and then this node is called again with that incremented value
solarradopt = Custom[solarradopt](family_instance=family_instance, parameter=parameter, amount_to_increment_by=amount_to_increment_by, maximum_base_case=maximum_base_case, current_parameter_value=add, accumulated_parameter_values_and_solar_data=solarradcomp, path_to_solar_data=path_to_solar_data, file_watcher_object=file_watcher_object)
# note: All of these operations are completed in order, before the next one fires, this is how to control flow in Dynamo
perform_all = Begin(expr1=reset_file_watcher, expr2=transaction, expr3=wait_for_change, expr4=pause, expr5=solarradopt)
# note: This is the comparison that ends our chain of recursive calls, when the parameter value is greater than our maximum value that we input, this test goes false, and instead of returning the next recursive call we return the accumulated list of
# results follow the graph back to see that this is true
if_ = Conditional(greaterthanequals, perform_all, accumulated_parameter_values_and_solar_d)
result = Output(if_)
