# Dynamo custom node solarradupdate.dyf (Dynamo 0.6.3.31046)
# category: Analyze.Solar

family_instance = Input()
parameter = Input()
# note: The index 1 in our list points to the second item [0,1] this is the parameter value, we extract this, and set the family instance to this value
number = DoubleInput(1)
# note: result is the final list [solar data, param value], since we held on to this, this is the best solution we found.
result = Input()
get_from_list = GetFromList(number, result)
set_element_parameter = FamilyInstanceParameterSetter(family_instance, parameter, get_from_list, lacing=Longest)
transaction = Transaction(set_element_parameter)
first_of_list = First(result)
perform_all = Begin(expr1=transaction, expr2=first_of_list)
