# Dynamo custom node Quadrilateral Pattern (Alternating Rows).dyf (Dynamo 0.6.3.5259)
# category: CAAD_RWTH.Patterning
# Creates groups of points from a list of UVs or XYZs for the placement of quadrilateral panels in alternating rows. The placement pattern can be reversed (boolean) and shifted (integer).

number = DoubleInput(2)
list = Input()
V = Input()
reverse = Input()  # "reverse?"
shift_placement = Input()
quadrilateral_pattern_from_grid = Custom[Quadrilateral Pattern From Grid](list=list, V=V, reverse=reverse, shift_placement=shift_placement)  # Creates groups of points from a list of UVs or XYZs for the placement of quadrilateral panels. The placement pattern can be reversed (boolean) and shifted (integer).
partition_list = Slice(quadrilateral_pattern_from_grid, V)
number_2 = DoubleInput(0)
drop_every_nth = RemoveEveryNth(number, partition_list, number_2)
number_3 = DoubleInput(1)
flatten = FlattenListAmt(drop_every_nth, number_3)
Odd_rows = Output(flatten)
take_every_nth = TakeEveryNth(number, partition_list, number_2)
flatten_2 = FlattenListAmt(take_every_nth, number_3)
Even_rows = Output(flatten_2)
