# Dynamo custom node Quadrilateral Pattern From Grid.dyf (Dynamo 0.6.3.5262)
# category: CAAD_RWTH.Patterning
# Creates groups of points from a list of UVs or XYZs for the placement of quadrilateral panels. The placement pattern can be reversed (boolean) and shifted (integer).

# note: Create sublists using placement pattern
list = Input()
formula = Formula("1", lacing=Longest)
shift_placement = Input()
round = Round(shift_placement, lacing=Longest)
# note: Reverse placement pattern (if applicable)
reverse = Input()  # "reverse?"
number = DoubleInput(0)
V = Input()
n1 = Custom[+1](V)  # Increments a value by 1
n1_2 = Custom[+1](n1)
# note: Create default placement pattern (counter-clockwise)
list_2 = NewList(index0=number, index1=n1, index2=n1_2, index3=formula)
reverse_2 = Reverse(list_2)
if_ = Conditional(reverse, reverse_2, list_2)
# note: Rotate placement pattern
shift_list_indeces = ShiftList(round, if_)
first_of_list = First(shift_list_indeces)
get_from_list = GetFromList(formula, shift_list_indeces)
formula_2 = Formula("2", lacing=Longest)
get_from_list_2 = GetFromList(formula_2, shift_list_indeces)
formula_3 = Formula("3", lacing=Longest)
get_from_list_3 = GetFromList(formula_3, shift_list_indeces)
build_sublists = Sublists("a,b,c,d", list, formula, first_of_list, get_from_list, get_from_list_2, get_from_list_3, lacing=Longest)
# note: For questions email me at dieckmann@caad.arch.rwth-aachen.de
n1_3 = Custom[+1](V)
# note: Unclutter
drop_last_row_column_from_uv = Custom[Drop Last Row & Column From UV Field](list=build_sublists, V=n1_3)  # Drops the last row and column from a UV field
list_3 = Output(drop_last_row_column_from_uv)  # "list"
