# Dynamo custom node Triangular Pattern (Flat, Diagonal) From Grid.dyf (Dynamo 0.6.3.5262)
# category: CAAD_RWTH.Patterning
# Creates groups of points from a list of UVs or XYZs for the placement of triangular panels. The placement pattern can be reversed (boolean) and shifted (integer).

list = Input()
V = Input()
n1 = Custom[+1](V)  # Increments a value by 1
reverse_triangle_A = Input()  # "reverse (triangle A)"
shift_placement_triangle_A = Input()  # "shift placement (triangle A)"
shift_overall_placement = Input()
# note: For questions email me at dieckmann@caad.arch.rwth-aachen.de
number = DoubleInput(0)
n1_2 = Custom[+1](n1)
formula = Formula("1", lacing=Longest)
list_2 = NewList(index0=number, index1=n1, index2=n1_2, index3=formula)
# note: Shift overall placement pattern
shift_list_indeces = ShiftList(shift_overall_placement, list_2)
first_of_list = First(shift_list_indeces)
get_from_list = GetFromList(formula, shift_list_indeces)
formula_2 = Formula("2", lacing=Longest)
get_from_list_2 = GetFromList(formula_2, shift_list_indeces)
triangular_subpattern = Custom[Triangular Subpattern](list=list, V=n1, Reverse_Pattern=reverse_triangle_A, Shift_Pattern=shift_placement_triangle_A, Point1=first_of_list, Point2=get_from_list, Point3=get_from_list_2)  # Subcomponent of the Triangular Pattern From Grid node.
list_triangle_A = Output(triangular_subpattern)  # "list (triangle A)"
reverse_triangle_B = Input()  # "reverse (triangle B)"
shift_placement_triangle_B = Input()  # "shift placement (triangle B)"
formula_3 = Formula("3", lacing=Longest)
get_from_list_3 = GetFromList(formula_3, shift_list_indeces)
triangular_subpattern_2 = Custom[Triangular Subpattern](list=list, V=n1, Reverse_Pattern=reverse_triangle_B, Shift_Pattern=shift_placement_triangle_B, Point1=get_from_list_2, Point2=get_from_list_3, Point3=first_of_list)
list_triangle_B = Output(triangular_subpattern_2)  # "list (triangle B)"
