# Dynamo custom node Triangular Subpattern.dyf (Dynamo 0.6.3.5259)
# category: CAAD_RWTH.Patterning.Helpers
# Subcomponent of the Triangular Pattern From Grid node.

list = Input()
formula = Formula("1", lacing=Longest)
Shift_Pattern = Input()
Reverse_Pattern = Input()
Point1 = Input()
Point2 = Input()
Point3 = Input()
# note: Create default placement patterns (counter-clockwise)
list_2 = NewList(index0=Point1, index1=Point2, index2=Point3)
reverse = Reverse(list_2)
# note: Reverse placement pattern
# (if applicable)
if_ = Conditional(Reverse_Pattern, reverse, list_2)
# note: Shift placement pattern
shift_list_indeces = ShiftList(Shift_Pattern, if_)
first_of_list = First(shift_list_indeces)
get_from_list = GetFromList(formula, shift_list_indeces)
formula_2 = Formula("2", lacing=Longest)
get_from_list_2 = GetFromList(formula_2, shift_list_indeces)
# note: Create sublists using placement pattern
build_sublists = Sublists("a,b,c", list, formula, first_of_list, get_from_list, get_from_list_2, lacing=Longest)
V = Input()
# note: Unclutter
drop_last_row_column_from_uv = Custom[Drop Last Row & Column From UV Field](list=build_sublists, V=V)  # Drops the last row and column from a UV field
list_3 = Output(drop_last_row_column_from_uv)  # "list"
