# Dynamo custom node outercustomnode.dyf (Dynamo 0.7.2.23480)
# category: testing
# outernode

x = Input()
number = DoubleInput(1)
add = x + number
innercustomnode = Custom[innercustomnode](inner=add)  # innernode
var = Output(innercustomnode)  # "var[]..[]"
