# Dynamo graph 5nodes7connectors12ports.dyn (Dynamo 2.13.0.2585)

code_block = CodeBlock { 1; 2; 3; }
byCoordinates = Point.ByCoordinates(x=code_block.out0, y=code_block.out1, z=code_block.out2)
byCenterPointRadius = Sphere.ByCenterPointRadius(centerPoint=byCoordinates)
radius = Sphere.Radius(sphere=byCenterPointRadius)
add = radius + code_block.out2
