# Dynamo graph customnode1.dyn (Dynamo 2.13.0.2585)

test1 = Custom[test1]()
byCenterPointRadius = Sphere.ByCenterPointRadius(centerPoint=test1.Point)
radius = Sphere.Radius(sphere=byCenterPointRadius)
add = radius + test1.out1
